# Grasshopper definition all.gh (Grasshopper 1.0.8)

file = ReadFile(File="G:\マイドライブ\研究\変更分析\BIM\Grasshopper\scripts_gh\common_wo_bake\road_surface_points.py", PerLineParse=False)
file_2 = ReadFile(File="G:\マイドライブ\研究\変更分析\BIM\Grasshopper\scripts_gh\bake.py", PerLineParse=False)
file_3 = ReadFile(File="G:\マイドライブ\研究\変更分析\BIM\Grasshopper\scripts_gh\bake.py", PerLineParse=False)
file_4 = ReadFile(File="G:\マイドライブ\研究\変更分析\BIM\Grasshopper\scripts_gh\bake.py", PerLineParse=False)
py3 = Python3Script(script=file)  # -> out, bake_keys, bake_objs, bake_keys2, bake_objs2, bake_keys3, bake_objs3, points, breps, crvs; unedited script template
py3_2 = Python3Script(script=file_2, keys=py3.bake_keys, values=py3.bake_objs, layer_index=Slider(1, range=0..20))  # -> out, result; inputs keys: list of String, values: list of Brep; disabled; unedited script template
py3_3 = Python3Script(script=file_3, keys=py3.bake_keys3, values=py3.bake_objs3, layer_index=Slider(3, range=0..10))  # -> out, result; inputs keys: list of String, values: list of Brep; disabled; unedited script template
py3_4 = Python3Script(script=file_4, keys=py3.bake_keys2, values=py3.bake_objs2, layer_index=Slider(2, range=0..10))  # -> out, result; inputs keys: list of String, values: list of Brep; disabled; unedited script template
panel = Panel(py3.out)
explode = ExplodeObject(Object=py3.bake_objs, Recursive=False)  # disabled
pt = Point(simplify(<point referenced from the Rhino model>))
pdecon = Deconstruct(Point=pt)  # -> XComponent, YComponent, ZComponent
format = Format(Format="{0:0.000}", Culture=127, Data0=pdecon.XComponent)
